% Simulink data dictionary DataDictionary.sldd

designSplineTotal = Simulink.Bus()
  designSpline1: Bus: designSpline1
  designSpline2: Bus: designSpline2

keyEventTotal = Simulink.Bus()
  KeyEvent2: Bus: keyEvent2
  KeyEvent1: Bus: keyEvent1

keyEventsAmount = 20

keyEvent2 = Simulink.Bus()
  keyEvent2Number: double
  keyEvent2Phase: double[20]
  keyEvent2y: double[20]
  keyEvent2dy: double[20]

keyEvent1 = Simulink.Bus()
  keyEvent1Number: double
  keyEvent1Phase: double[20]
  keyEvent1y: double[20]
  keyEvent1dy: double[20]

Sig = Simulink.Signal()
numberSamplePoints = 1000
Sig1 = Simulink.Signal()

designSpline1 = Simulink.Bus()
  y1: double[1000]
  dydx1: double[1000]
  d2ydx21: double[1000]
  d3ydx31: double[1000]

designSpline2 = Simulink.Bus()
  y2: double[1000]
  dydx2: double[1000]
  d2ydx22: double[1000]
  d3ydx32: double[1000]

generatedSplines = Simulink.Bus()
  x: double[1000]
  y: double[1000]
  p: double[1000]
  dpdx: double[1000]
  d2pdx2: double[1000]
  d3pdx3: double[1000]